# Grasshopper definition CaseE(Niigata).ghx (Grasshopper 1.0.8)
# plug-ins: Pufferfish, Outdoor

panel = Panel("""0.005 
0.010 
0.020 
0.030 
0.050 
0.100 
0.200 
0.300 
0.400 
0.600 
0.800 
1.000 """)
panel_2 = Panel("""0.365 
0.390 
0.418 
0.437 
0.483 
0.559 
0.655 
0.730 
0.790 
0.893 
0.948 
1.000 """)
panel_3 = Panel("""0.008 
0.009 
0.009 
0.009 
0.010 
0.010 
0.009 
0.008 
0.007 
0.006 
0.004 
0.002 """)
number_slider = Slider(3, range=0..10)
series = Series(Start=0, Step="22.5", Count=Slider(16, range=0..100))
panel_4 = Panel(series)
inflow = ManualInflowProfile(
    WindDirections=series,
    NormalizedHeightZZR=panel,
    NormalizedVelocityUUR=panel_2,
    NormalizedTKEKUR2=panel_3,
    BoundaryLayerHeightZR=250,
    ReferenceVelocityUR=7.8,
    RoughnessLengthZ0=1,
    Cmu=0.09)  # -> BoundaryConditions, WindVectors
meshsettings = MeshSettings(
    RefinementBoxLevel=number_slider,
    BuildingSurfaceLevel=number_slider,
    BuildingFeatureLevel=number_slider,
    GroundSurfaceLevel=number_slider,
    LayerCount=4,
    AddLayers=False,
    Snap=True,
    GradingStrengthHorizontal=6,
    GradingStrengthVertical=6,
    AdaptiveGrading=True,
    WakeRefinement=3)
runsettings = RunSettings(
    Iterations=1000,
    WriteInterval=Slider(50, range=0..100),
    KeepTimeSteps=3,
    TurbulenceModel="realizableKE",
    CPUCount="80",
    SolverAlgorithm="SIMPLE",
    AgeOfAir=False,
    Robustness="4",
    PotentialFoamInit=False)  # -> RunSettings, DebugLogs
buildings = Mesh([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])

# ---- group: Newly Constructed
mesh = Mesh([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])

# ----
cyldomain = CylinderDomain(
    CoreCellSize=20,
    InnerCoreSize=-1,
    OuterRadius=600,
    Height="250",
    RadialMultiplier=2,
    CoreDivisions=1,
    RefinementBoxExtension=-1,
    RadialGrading=1.3,
    CoreRoundness=0.6,
    VerticalGrading=1)
merge = Merge(Data1=buildings, Data2=mesh)
path = FilePath("C:\Eddy3D-Cases\")

# ---- group: Terrain
srf = Surface(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)

# ----
panel_5 = Panel("""-27
-93
-88
-74
-61
-50.5
-33.5
-9.5
7
45
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""")
panel_6 = Panel("""112
33
35
40
45.5
49.5
57.5
69
76.5
94
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""")
windcase = WindCase(
    CaseName="AIJ_CASE_E_cleaned_Y",
    WorkingDirectory=path,
    BoundaryConditions=inflow.BoundaryConditions,
    DomainParameters=cyldomain,
    Buildings=merge,
    Terrain=srf,
    MeshSettings=meshsettings,
    RunSettings=runsettings.RunSettings,
    WriteCase=Toggle(True),
    ClearCase=False,
    PreviewDimensions=True,
    PreviewGrid3D=False,
    PreviewGroundGrid=True,
    PreviewWindArrows=True)  # -> Logs, WriteLogs, Case, Domain, RefinementBox, Buildings
box = Box(windcase.RefinementBox)
pt = ConstructPoint(XCoordinate=panel_5, YCoordinate=panel_6, ZCoordinate="2")
lng = ListLength(List=pt)
run = Run(
    Case=windcase.Case,
    Mesh=False,
    Simulate=False,
    RunAll=False,
    Parallel=True,
    Direction=-1,
    ShowDirection=True,
    ShowZones=False)
cir = Circle(Plane=pt, Radius=3)
scripts = WriteRunScripts(Case=windcase.Case, Parallel=True, Engine="BlueCFD", ProbeName="windProbes", Write=Toggle(True))  # -> ScriptsFolder, Logs
series_2 = Series(Start=1, Step=1, Count=lng)
panel_7 = Panel(run)
tag = TextTag(Location=pt, Text=series_2, Colour=RGB(0, 0, 0))
probe = Probe(
    Case=windcase.Case,
    Points=pt,
    Fields="U",
    ProbeName="ttt",
    Run=False,
    BakeTimeHistory=False,
    CullHugeVectors=True,
    CullInvalid=True,
    ShowRegion=False)  # -> Values, TimeSteps, SubResults
ref_velocity_at_15_9m_as_described_in_th = Panel("3.93")  # "Ref velocity at 15.9m as described in the AIJ case E"
vlen = VectorLength(Vector=probe.Values)
number_slider_2 = Slider(1.8, range=0..10)
division = Division(A=vlen, B=ref_velocity_at_15_9m_as_described_in_th)  # -> flatten(Result)
roundd = RoundToDecimalPlace(NumberX=division, DecimalPlace=2, RoundType=0)  # -> Rounded, Difference

# ---- group: Comparison for North direction
cfd = Panel(roundd.Rounded)
north_ground_truth = Panel("""0.18 
0.59 
0.38 
0.32 
0.30 
0.34 
0.26 
0.14 
0.12 
0.10 
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""")
